# Grasshopper definition Candelabrum.ghx (Grasshopper 1.0.7)

knob = ControlKnob(Decimals=0, Limit=True, Maximum=99, Minimum=0, Range=10, Value=1)
cluster = Cluster(D=[Slider(0, range=0..9), knob])
panel = Panel(cluster)

number_slider = Slider(5, range=0..10)
cir = Circle(Plane=PlaneXY(0, 0, 0), Radius=number_slider)
Z = UnitZ(Factor=Slider(10, range=0..10))
move = Move(Geometry=cir, Motion=Z)  # -> Geometry, Transform

# ---- group: A
cir_a = Curve(move.Geometry)

# ----
multiplication = Multiplication(A=number_slider, B=Slider(2.5, range=0..5))
offset = OffsetCurve(Curve=cir_a, Distance=multiplication, Corners=1)
Z_2 = UnitZ(Factor=Slider(-2, range=-5..0))
move_2 = Move(Geometry=offset, Motion=Z_2)  # -> Geometry, Transform

offset_2 = OffsetCurve(Curve=cir_a, Distance=Slider(-1.4, range=-3..3), Corners=1)
Z_3 = UnitZ(Factor=Slider(0.2, range=0..2))
move_3 = Move(Geometry=offset_2, Motion=Z_3)  # -> Geometry, Transform

# ---- group: B
cir_a_2 = Curve(move_2.Geometry)

# ---- group: 1
crv = Curve(move_3.Geometry)

# ----
series = Series(Start=0, Step=1, Count=Slider(6, range=0..7))
bnd = Bounds(Numbers=series)
remap = RemapNumbers(Value=series, Source=bnd, Target=Domain(0, 1))  # -> Mapped, Clipped
graph = GraphMapper(
    remap.Mapped,
    x0=0,
    x1=1,
    y0=0,
    y1=10,
    container_name="Bezier",
    cpx=[0, 0.807466805, 0.2748494148, 1],
    cpy=[0, 0.2821345925, 0, 1])
split = SplitList(List=graph, Index="1")  # -> ListA, ListB
offset_3 = OffsetCurve(Curve=crv, Distance=split.ListB, Corners=1)  # -> simplify(Curve)
bang = ExplodeTree(Data=offset_3)  # -> Branch0, Branch1, Branch2, Branch3, Branch4

# ---- group: 2
crv_2 = Curve(bang.Branch0)

# ---- group: 3
crv_3 = Curve(bang.Branch1)

# ---- group: 4
crv_4 = Curve(bang.Branch2)

# ---- group: 5
crv_5 = Curve(bang.Branch3)

# ---- group: 6
crv_6 = Curve(bang.Branch4)

# ----
divide = DivideCurve(Curve=cir_a, Count="16", Kinks=False)  # -> Points, Tangents, Parameters
shift = ShiftList(List=divide.Points, Shift=1, Wrap=True)
ln = Line(StartPoint=divide.Points, EndPoint=shift)
join = JoinCurves(Curves=ln, Preserve=False)

# ---- group: A
cir_a_3 = Curve(join)

# ----
divide_2 = DivideCurve(Curve=crv_6, Count="16", Kinks=False)  # -> Points, Tangents, Parameters
divide_3 = DivideCurve(Curve=crv_3, Count="16", Kinks=False)  # -> Points, Tangents, Parameters
divide_4 = DivideCurve(Curve=crv_4, Count="16", Kinks=False)  # -> Points, Tangents, Parameters
divide_5 = DivideCurve(Curve=crv_5, Count="16", Kinks=False)  # -> Points, Tangents, Parameters
shift_2 = ShiftList(List=divide_3.Points, Shift=1, Wrap=True)
shift_3 = ShiftList(List=divide_4.Points, Shift=1, Wrap=True)
shift_4 = ShiftList(List=divide_2.Points, Shift=1, Wrap=True)
Z_4 = UnitZ(Factor=Slider(-0.67, range=-1..0))
shift_5 = ShiftList(List=divide_5.Points, Shift=1, Wrap=True)
divide_6 = DivideCurve(Curve=move_2.Geometry, Count="16", Kinks=False)  # -> Points, Tangents, Parameters
ln_2 = Line(StartPoint=divide_3.Points, EndPoint=shift_2)
ln_3 = Line(StartPoint=divide_4.Points, EndPoint=shift_3)
divide_7 = DivideCurve(Curve=crv_2, Count="16", Kinks=False)  # -> Points, Tangents, Parameters
Z_5 = UnitZ(Factor="1")
ln_4 = Line(StartPoint=divide_2.Points, EndPoint=shift_4)
ln_5 = Line(StartPoint=divide_5.Points, EndPoint=shift_5)
move_4 = Move(Geometry=divide_6.Points, Motion=Z_4)  # -> Geometry, Transform
line = LineSDL(Start=move_4.Geometry, Direction=Z_5, Length=Slider(5.9, range=0..8))

# ---- group: 4
crv_7 = Curve(ln_3)

# ---- group: 6
crv_8 = Curve(ln_4)

# ---- group: 3
crv_9 = Curve(ln_2)

# ---- group: 5
crv_10 = Curve(ln_5)

# ----
join_2 = JoinCurves(Curves=crv_8, Preserve=False)
ln_6 = Line(StartPoint=move_4.Geometry, EndPoint=divide_7.Points)
ln_7 = Line(StartPoint=divide_3.Points, EndPoint=divide_2.Points)
end = EndPoints(Curve=line)  # -> Start, End
number_slider_2 = Slider(0, range=0..100)
vec2pt = Vector2Pt(PointA=move_4.Geometry, PointB=divide_7.Points, Unitize=False)  # -> Vector, Length
offset_4 = OffsetCurve(Curve=cir_a_3, Distance=Slider(-0.07, range=-1..0), Corners=1)
pt = Point(divide_2.Points)
pt_2 = Point(divide_4.Points)
pt_3 = Point(divide_5.Points)
pt_4 = Point(end.End)
loft = Loft(Curves=ln_6, Options={Adjust=False, Closed=True, LoftEnds=0, LoftSimp=0, LoftType=0, Rebuild=10, Refit=0.01})
join_3 = JoinCurves(Curves=crv_9, Preserve=False)
offset_5 = OffsetCurve(Curve=join_2, Distance=Slider(-9.3, range=-10..0), Corners=1)
Z_6 = UnitZ(Factor=Slider(0.1, range=0..1))
pipe = Pipe(Curve=line, Radius=Slider(0.08, range=0..0.3), Caps=0)
move_5 = Move(Geometry=offset_4, Motion=Z_6)  # -> Geometry, Transform
ln_8 = Line(StartPoint=pt_4, EndPoint=pt)
end_2 = EndPoints(Curve=ln_8)  # -> Start, End
Z_7 = UnitZ(Factor="-1")
Z_8 = UnitZ(Factor="-1")
Z_9 = UnitZ(Factor="-1")
entwine = Entwine(Branch00=cir_a_3, Branch01=move_5.Geometry, Branch02=join_3, FlattenInputs=True)  # -> flatten(Result)
project = ProjectPoint(Point=pt, Direction=Z_8, Geometry=loft)  # -> Point, Index
project_2 = ProjectPoint(Point=pt_2, Direction=Z_9, Geometry=loft)  # -> Point, Index
project_3 = ProjectPoint(Point=pt_3, Direction=Z_7, Geometry=loft)  # -> Point, Index
pipe_2 = Pipe(Curve=[ln_6, ln_8], Radius=Slider(0.15, range=0..0.3), Caps=Slider(1, range=0..2))
pt_5 = Point(project.Point)
pt_6 = Point(project_2.Point)
pt_7 = Point(project_3.Point)
ln_9 = Line(StartPoint=pt_3, EndPoint=project_3.Point)
ln_10 = Line(StartPoint=project.Point, EndPoint=end_2.End)
shift_6 = ShiftList(List=pt_5, Shift=1, Wrap=True)
ln_11 = Line(StartPoint=pt_2, EndPoint=project_2.Point)
shift_7 = ShiftList(List=pt_5, Shift="-1", Wrap=True)
loft_2 = Loft(Curves=entwine, Options={Adjust=False, Closed=False, LoftEnds=0, LoftSimp=0, LoftType=0, Rebuild=10, Refit=0.01})
crv_11 = Curve(ln_9)
crv_12 = Curve(ln_10)
ln_12 = Line(StartPoint=pt_4, EndPoint=shift_6)
ln_13 = Line(StartPoint=pt_4, EndPoint=shift_7)
crv_13 = Curve(ln_11)
pipe_3 = Pipe(Curve=[crv_13, crv_11, crv_12, ln_7], Radius=Slider(0.08, range=0..0.3), Caps=0)
pt_8 = Point(divide_3.Points)
shift_8 = ShiftList(List=crv_11, Shift=1, Wrap=True)
shift_9 = ShiftList(List=crv_11, Shift="-1", Wrap=True)
shift_10 = ShiftList(List=pt, Shift=1, Wrap=True)
shift_11 = ShiftList(List=crv_11, Shift=1, Wrap=True)
shift_12 = ShiftList(List=pt_8, Shift=1, Wrap=True)
shift_13 = ShiftList(List=crv_11, Shift="-1", Wrap=True)
shift_14 = ShiftList(List=pt_8, Shift="-1", Wrap=True)
pt_9 = Point(move_4.Geometry)
crv_14 = Curve(ln_12)
end_3 = EndPoints(Curve=crv_12)  # -> Start, End
end_4 = EndPoints(Curve=shift_8)  # -> Start, End
end_5 = EndPoints(Curve=crv_12)  # -> Start, End
end_6 = EndPoints(Curve=shift_9)  # -> Start, End
end_7 = EndPoints(Curve=crv_13)  # -> Start, End
end_8 = EndPoints(Curve=crv_13)  # -> Start, End
end_9 = EndPoints(Curve=crv_13)  # -> Start, End
end_10 = EndPoints(Curve=shift_11)  # -> Start, End
end_11 = EndPoints(Curve=crv_13)  # -> Start, End
end_12 = EndPoints(Curve=shift_13)  # -> Start, End
ln_14 = Line(StartPoint=end_4.Start, EndPoint=end_5.Start)
ln_15 = Line(StartPoint=end_3.Start, EndPoint=end_6.Start)
ln_16 = Line(StartPoint=end_10.End, EndPoint=end_11.Start)
ln_17 = Line(StartPoint=shift_12, EndPoint=end_8.End)
ln_18 = Line(StartPoint=end_9.Start, EndPoint=end_12.End)
ln_19 = Line(StartPoint=shift_14, EndPoint=end_7.End)
shift_15 = ShiftList(List=pt_9, Shift=1, Wrap=True)
ln_20 = Line(StartPoint=pt, EndPoint=shift_15)
ln_21 = Line(StartPoint=pt_9, EndPoint=shift_10)
crv_15 = Curve(ln_21)
llx = LineLine(Line1=crv_14, Line2=crv_15)  # -> ParamA, ParamB, PointA, PointB
pt_10 = Point(llx.PointA)
crv_16 = Curve(ln_13)
pipe_4 = Pipe(Curve=[ln_18, ln_16, ln_15, ln_14, ln_19, ln_17], Radius=Slider(0.08, range=0..0.3), Caps=0)
crv_17 = Curve(ln_20)
llx_2 = LineLine(Line1=ln_21, Line2=ln_20)  # -> ParamA, ParamB, PointA, PointB
boundary = BoundarySurfaces(Edges=flatten([join_2, offset_5]))
shift_16 = ShiftList(List=crv_17, Shift="-1", Wrap=True)
llx_3 = LineLine(Line1=crv_16, Line2=shift_16)  # -> ParamA, ParamB, PointA, PointB
pt_11 = Point(llx_2.PointA)
Z_10 = UnitZ(Factor=graft(["1", "-1"]))
pt_12 = Point(llx_3.PointA)
line_2 = LineSDL(Start=pt_11, Direction=Z_10, Length=1)
Z_11 = UnitZ(Factor=graft(["1", "-1"]))
flip = FlipMatrix(Data=line_2)
crv_18 = Curve(line)
line_3 = LineSDL(Start=pt_10, Direction=Z_11, Length=Slider(0.3, range=0..1))
join_4 = JoinCurves(Curves=flip, Preserve=False)  # -> flatten(Curves)
Z_12 = UnitZ(Factor=graft(["1", "-1"]))
flip_2 = FlipCurve(Curve=crv_18)  # -> Curve, Flag
flip_3 = FlipMatrix(Data=line_3)
line_4 = LineSDL(Start=pt_12, Direction=Z_12, Length=Slider(0.3, range=0..1))
shift_17 = ShiftList(List=flip_2.Curve, Shift=1, Wrap=True)
entwine_2 = Entwine(Branch00=join_4, Branch01=shift_17, FlattenInputs=True)
entwine_3 = Entwine(Branch00=flip_2.Curve, Branch01=join_4, FlattenInputs=True)
crv_19 = Curve(ln_10)
flip_4 = FlipMatrix(Data=entwine_2)
flip_5 = FlipMatrix(Data=line_4)
flip_6 = FlipMatrix(Data=entwine_3)
join_5 = JoinCurves(Curves=flip_3, Preserve=False)  # -> flatten(Curves)
join_6 = JoinCurves(Curves=flip_5, Preserve=False)  # -> flatten(Curves)
loft_3 = Loft(Curves=flip_6, Options={Adjust=False, Closed=False, LoftEnds=0, LoftSimp=0, LoftType=0, Rebuild=10, Refit=0.01})  # -> flatten(Loft)
flip_7 = FlipCurve(Curve=join_5)  # -> Curve, Flag
shift_18 = ShiftList(List=crv_19, Shift="-1", Wrap=True)
loft_4 = Loft(Curves=flip_4, Options={Adjust=False, Closed=False, LoftEnds=0, LoftSimp=0, LoftType=0, Rebuild=10, Refit=0.01})  # -> flatten(Loft)
flip_8 = FlipCurve(Curve=join_6)  # -> Curve, Flag
shift_19 = ShiftList(List=crv_19, Shift=1, Wrap=True)
entwine_4 = Entwine(Branch00=flip_8.Curve, Branch01=shift_18, FlattenInputs=True)
edges = BrepEdges(Brep=loft_3)  # -> Naked, Interior, NonManifold
edges_2 = BrepEdges(Brep=loft_4)  # -> Naked, Interior, NonManifold
entwine_5 = Entwine(Branch00=flip_7.Curve, Branch01=shift_19, FlattenInputs=True)
number_slider_3 = Slider(6, range=3..7)
pipe_5 = Pipe(Curve=[ln_21, ln_20, crv_16, crv_17, crv_14], Radius=Slider(0.08, range=0..0.3), Caps=0)
number_slider_4 = Slider(6, range=3..7)
item = ListItem(List=edges_2.Naked, Index=["0", "2"], Wrap=True)
item_2 = ListItem(List=edges.Naked, Index=["0", "2"], Wrap=True)
flip_9 = FlipMatrix(Data=entwine_4)
divide_8 = DivideCurve(Curve=item_2, Count=number_slider_3, Kinks=False)  # -> Points, Tangents, Parameters
flip_10 = FlipMatrix(Data=entwine_5)
divide_9 = DivideCurve(Curve=item, Count=number_slider_4, Kinks=False)  # -> Points, Tangents, Parameters
dom = ConstructDomain(DomainStart="1", DomainEnd=expr("x - 1", number_slider_3))
dom_2 = ConstructDomain(DomainStart="1", DomainEnd=expr("x -1", number_slider_4))
subset = SubList(List=divide_8.Points, Domain=dom, Wrap=True)  # -> simplify(List), Index
viewer = ParamViewer(subset.List)
subset_2 = SubList(List=divide_9.Points, Domain=dom_2, Wrap=True)  # -> simplify(List), Index
loft_5 = Loft(Curves=flip_10, Options={Adjust=False, Closed=False, LoftEnds=0, LoftSimp=0, LoftType=0, Rebuild=10, Refit=0.01})  # -> flatten(Loft)
loft_6 = Loft(Curves=flip_9, Options={Adjust=False, Closed=False, LoftEnds=0, LoftSimp=0, LoftType=0, Rebuild=10, Refit=0.01})  # -> flatten(Loft)
path_mapper = PathMapper(subset_2.List, source="{A;1}", target="{1;A}")
path_mapper_2 = PathMapper(subset_2.List, source="{A;2}", target="{2;A}")
path_mapper_3 = PathMapper(subset.List, source="{A;0}", target="{0;A}")
path_mapper_4 = PathMapper(subset.List, source="{A;1}", target="{1;A}")
dom_3 = ConstructDomain(DomainStart=expr("x - 1", "1"), DomainEnd=expr("x - 2", number_slider_3))
pt_13 = Point(path_mapper_3)
pt_14 = Point(path_mapper_4)
edges_3 = BrepEdges(Brep=loft_5)  # -> Naked, Interior, NonManifold
viewer_2 = ParamViewer(pt_14)
viewer_3 = ParamViewer(pt_13)
dom_4 = ConstructDomain(DomainStart=expr("x - 1", "1"), DomainEnd=expr("x - 2", number_slider_4))
edges_4 = BrepEdges(Brep=loft_6)  # -> Naked, Interior, NonManifold
dom_5 = ConstructDomain(DomainStart=expr("x - 1", number_slider_3), DomainEnd=expr("2 * (x - 1) - 1", number_slider_3))
dom_6 = ConstructDomain(DomainStart=expr("x - 1", number_slider_4), DomainEnd=expr("2 * (x - 1) - 1", number_slider_4))
subset_3 = SubList(List=pt_13, Domain=dom_3, Wrap=True)  # -> List, Index
subset_4 = SubList(List=pt_14, Domain=dom_5, Wrap=True)  # -> List, Index
subset_5 = SubList(List=path_mapper, Domain=dom_4, Wrap=True)  # -> List, Index
subset_6 = SubList(List=path_mapper_2, Domain=dom_6, Wrap=True)  # -> List, Index
number_slider_5 = Slider(5, range=3..7)
number_slider_6 = Slider(5, range=3..7)
item_3 = ListItem(List=edges_4.Naked, Index=["0", "2"], Wrap=True)
item_4 = ListItem(List=edges_3.Naked, Index=["0", "2"], Wrap=True)
rev = ReverseList(List=subset_4.List)
rev_2 = ReverseList(List=subset_6.List)
ln_22 = Line(StartPoint=subset_3.List, EndPoint=rev)
ln_23 = Line(StartPoint=subset_5.List, EndPoint=rev_2)
divide_10 = DivideCurve(Curve=item_4, Count=number_slider_5, Kinks=False)  # -> Points, Tangents, Parameters
divide_11 = DivideCurve(Curve=item_3, Count=number_slider_6, Kinks=False)  # -> Points, Tangents, Parameters
midpt = CurveMiddle(Curve=ln_23)
viewer_4 = ParamViewer(subset_3.List)
midpt_2 = CurveMiddle(Curve=ln_22)
viewer_5 = ParamViewer(subset_4.List)
dom_7 = ConstructDomain(DomainStart="1", DomainEnd=expr("x - 1", number_slider_5))
dom_8 = ConstructDomain(DomainStart="1", DomainEnd=expr("x -1", number_slider_6))
Z_13 = UnitZ(Factor=expr("- x", Slider(1, range=0..4)))
subset_7 = SubList(List=divide_10.Points, Domain=dom_7, Wrap=True)  # -> simplify(List), Index
subset_8 = SubList(List=divide_11.Points, Domain=dom_8, Wrap=True)  # -> simplify(List), Index
move_6 = Move(Geometry=midpt, Motion=Z_13)  # -> Geometry, Transform
Z_14 = UnitZ(Factor=expr("- x", Slider(1, range=0..4)))
move_7 = Move(Geometry=midpt_2, Motion=Z_14)  # -> Geometry, Transform
scale = Scale(Geometry=ln_23, Center=move_6.Geometry, Factor=Slider(1.33, range=1..1.7))  # -> Geometry, Transform
scale_2 = Scale(Geometry=ln_22, Center=move_7.Geometry, Factor=Slider(1.33, range=1..1.7))  # -> Geometry, Transform
path_mapper_5 = PathMapper(subset_7.List, source="{A;0}", target="{0;A}")
path_mapper_6 = PathMapper(subset_7.List, source="{A;1}", target="{1;A}")
dom_9 = ConstructDomain(DomainStart=expr("x - 1", "1"), DomainEnd=expr("x - 2", number_slider_5))
path_mapper_7 = PathMapper(subset_8.List, source="{A;1}", target="{1;A}")
path_mapper_8 = PathMapper(subset_8.List, source="{A;2}", target="{2;A}")
pt_15 = Point(path_mapper_5)
pt_16 = Point(path_mapper_6)
dom_10 = ConstructDomain(DomainStart=expr("x - 1", "1"), DomainEnd=expr("x - 2", number_slider_6))
pipe_6 = Pipe(Curve=[scale_2.Geometry, scale.Geometry], Radius=Slider(0.06, range=0..0.3), Caps=0)
dom_11 = ConstructDomain(DomainStart=expr("x - 1", number_slider_5), DomainEnd=expr("2 * (x - 1) - 1", number_slider_5))
dom_12 = ConstructDomain(DomainStart=expr("x - 1", number_slider_6), DomainEnd=expr("2 * (x - 1) - 1", number_slider_6))
subset_9 = SubList(List=pt_15, Domain=dom_9, Wrap=True)  # -> List, Index
subset_10 = SubList(List=pt_16, Domain=dom_11, Wrap=True)  # -> List, Index
subset_11 = SubList(List=path_mapper_7, Domain=dom_10, Wrap=True)  # -> List, Index
subset_12 = SubList(List=path_mapper_8, Domain=dom_12, Wrap=True)  # -> List, Index
rev_3 = ReverseList(List=subset_10.List)
rev_4 = ReverseList(List=subset_12.List)
ln_24 = Line(StartPoint=subset_9.List, EndPoint=rev_3)
ln_25 = Line(StartPoint=subset_11.List, EndPoint=rev_4)
midpt_3 = CurveMiddle(Curve=ln_25)
midpt_4 = CurveMiddle(Curve=ln_24)
Z_15 = UnitZ(Factor=expr("- x", Slider(1, range=0..4)))
move_8 = Move(Geometry=midpt_3, Motion=Z_15)  # -> Geometry, Transform
Z_16 = UnitZ(Factor=expr("- x", Slider(0.36, range=0..4)))
scale_3 = Scale(Geometry=ln_25, Center=move_8.Geometry, Factor=Slider(1.33, range=1..1.7))  # -> Geometry, Transform
move_9 = Move(Geometry=midpt_4, Motion=Z_16)  # -> Geometry, Transform
scale_4 = Scale(Geometry=ln_24, Center=move_9.Geometry, Factor=Slider(1.38, range=1..1.7))  # -> Geometry, Transform
pipe_7 = Pipe(Curve=[ln_24, ln_25, scale_4.Geometry, scale_3.Geometry], Radius=Slider(0.06, range=0..0.3), Caps=0)
brep = Brep(boundary)
material = CreateMaterial(
    Diffuse=ColourSwatch(SwatchColor=RGB(255, 254, 254)),
    Specular=RGB(255, 254, 254),
    Emission=RGB(0, 0, 0),
    Transparency=0,
    Shine=0)
brep_2 = Brep(brep)
brep_3 = Brep(pipe_5)
brep_4 = Brep(pipe_2)
brep_5 = Brep(pipe_7)
brep_6 = Brep(pipe_6)
brep_7 = Brep(loft_2)
brep_8 = Brep(pipe)
brep_9 = Brep(pipe_4)
brep_10 = Brep(pipe_3)
geo = Geometry([brep_5, brep_6, brep_3, brep_4, brep_8, brep_9, brep_10, brep_7, brep_2])
preview = CustomPreview(Geometry=geo, Material=material)  # disabled

# ==== cluster Cluster
D = ClusterInput()
list = ValueList({"ALPHA": "ALPHA.a.", "BETA": "BETA.0.", "<Stable>": "1."}, selected="ALPHA")
bang = ExplodeTree(Data=graft(D))  # -> Branch0, Branch1
entwine = Entwine(
    Branch00="Candelabrum",
    Branch01="Ver-",
    Branch02=list,
    Branch03=bang.Branch0,
    Branch04=".",
    Branch05=bang.Branch1,
    FlattenInputs=True)  # -> flatten(Result)
join = TextJoin(Text=entwine)
R = ClusterOutput(join)
