# Grasshopper definition Candelabrum.ghx (Grasshopper 1.0.7)

knob = ControlKnob(Decimals=0, Limit=True, Maximum=99, Minimum=0, Range=10, Value=5)
list = ValueList({"ALPHA": "ALPHA.a.", "Beta": "Beta.0.", "Stable": " "}, selected="ALPHA")
ver = VersionCreate(P="Candelabrum", D=[list, Slider(1, range=1..9)], V=Slider(0, range=0..9), D_2=knob)
panel = Panel(ver)

number_slider = Slider(5, range=0..10)
cir = Circle(Plane=PlaneXY(0, 0, 0), Radius=number_slider)
Z = UnitZ(Factor=Slider(10, range=0..10))
move = Move(Geometry=cir, Motion=Z)  # -> Geometry, Transform

# ---- group: A
cir_a = Curve(move.Geometry)

# ----
multiplication = Multiplication(A=number_slider, B=Slider(2.5, range=0..5))
offset = OffsetCurve(Curve=cir_a, Distance=multiplication, Corners=1)
Z_2 = UnitZ(Factor=Slider(-2, range=-5..0))
move_2 = Move(Geometry=offset, Motion=Z_2)  # -> Geometry, Transform

offset_2 = OffsetCurve(Curve=cir_a, Distance=Slider(-1.4, range=-3..3), Corners=1)
Z_3 = UnitZ(Factor=Slider(0.2, range=0..2))
move_3 = Move(Geometry=offset_2, Motion=Z_3)  # -> Geometry, Transform

# ---- group: B
cir_a_2 = Curve(move_2.Geometry)

# ---- group: 1
crv = Curve(move_3.Geometry)

# ----
series = Series(Start=0, Step=1, Count=Slider(6, range=0..7))
bnd = Bounds(Numbers=series)
remap = RemapNumbers(Value=series, Source=bnd, Target=Domain(0, 1))  # -> Mapped, Clipped
graph = GraphMapper(
    remap.Mapped,
    x0=0,
    x1=1,
    y0=0,
    y1=10,
    container_name="Bezier",
    cpx=[0, 0.807466805, 0.2748494148, 1],
    cpy=[0, 0.2821345925, 0, 1])
split = SplitList(List=graph, Index="1")  # -> ListA, ListB
offset_3 = OffsetCurve(Curve=crv, Distance=split.ListB, Corners=1)  # -> simplify(Curve)
bang = ExplodeTree(Data=offset_3)  # -> Branch0, Branch1, Branch2, Branch3, Branch4

# ---- group: 2
crv_2 = Curve(bang.Branch0)

# ---- group: 3
crv_3 = Curve(bang.Branch1)

# ---- group: 4
crv_4 = Curve(bang.Branch2)

# ---- group: 5
crv_5 = Curve(bang.Branch3)

# ---- group: 6
crv_6 = Curve(bang.Branch4)

# ----
divide = DivideCurve(Curve=cir_a, Count="16", Kinks=False)  # -> Points, Tangents, Parameters
entwine = Entwine(Branch00=crv_3, Branch01=crv_4, Branch02=crv_5, Branch03=crv_6, FlattenInputs=True)
shift = ShiftList(List=divide.Points, Shift=1, Wrap=True)
ln = Line(StartPoint=divide.Points, EndPoint=shift)
divide_2 = DivideCurve(Curve=entwine, Count=Slider(16, range=1..50), Kinks=False)  # -> simplify(Points), Tangents, Parameters
join = JoinCurves(Curves=ln, Preserve=False)
shift_2 = ShiftList(List=divide_2.Points, Shift=1, Wrap=True)
bang_2 = ExplodeTree(Data=divide_2.Points)  # -> Branch0, Branch1, Branch2, Branch3
ln_2 = Line(StartPoint=divide_2.Points, EndPoint=shift_2)
pt = Point(bang_2.Branch0)
join_2 = JoinCurves(Curves=ln_2, Preserve=False)
pt_2 = Point(bang_2.Branch1)
bang_3 = ExplodeTree(Data=join_2)  # -> Branch0, Branch1, Branch2, Branch3
pt_3 = Point(bang_2.Branch2)
pt_4 = Point(bang_2.Branch3)
ln_3 = Line(StartPoint=pt, EndPoint=pt_4)

# ---- group: A
cir_a_3 = Curve(join)

# ---- group: B
cir_a_4 = Curve(cir_a_2)

# ---- group: 1
cir_a_5 = Curve(crv)

# ---- group: 2
cir_a_6 = Curve(crv_2)

# ---- group: 3
crv_7 = Curve(bang_3.Branch0)

# ---- group: 4
crv_8 = Curve(bang_3.Branch1)

# ---- group: 5
crv_9 = Curve(bang_3.Branch2)

# ---- group: 6
crv_10 = Curve(bang_3.Branch3)

# ----
offset_4 = OffsetCurve(Curve=cir_a_3, Distance=Slider(-0.07, range=-1..0), Corners=1)
Z_4 = UnitZ(Factor=Slider(-0.67, range=-1..0))
divide_3 = DivideCurve(Curve=cir_a_2, Count="16", Kinks=False)  # -> Points, Tangents, Parameters
divide_4 = DivideCurve(Curve=crv_2, Count="16", Kinks=False)  # -> Points, Tangents, Parameters
move_4 = Move(Geometry=divide_3.Points, Motion=Z_4)  # -> Geometry, Transform
ln_4 = Line(StartPoint=move_4.Geometry, EndPoint=divide_4.Points)
Z_5 = UnitZ(Factor=Slider(0.1, range=0..1))
Z_6 = UnitZ(Factor="1")
loft = Loft(Curves=ln_4, Options={Adjust=False, Closed=True, LoftEnds=0, LoftSimp=0, LoftType=0, Rebuild=10, Refit=0.01})
move_5 = Move(Geometry=offset_4, Motion=Z_5)  # -> Geometry, Transform
line = LineSDL(Start=move_4.Geometry, Direction=Z_6, Length=Slider(5.9, range=0..8))
pipe = Pipe(Curve=line, Radius=Slider(0.08, range=0..0.3), Caps=0)
end = EndPoints(Curve=line)  # -> Start, End
pt_5 = Point(end.End)
ln_5 = Line(StartPoint=pt_5, EndPoint=pt_4)
end_2 = EndPoints(Curve=ln_5)  # -> Start, End
offset_5 = OffsetCurve(Curve=crv_10, Distance=Slider(-9.3, range=-10..0), Corners=1)
Z_7 = UnitZ(Factor="-1")
Z_8 = UnitZ(Factor="-1")
Z_9 = UnitZ(Factor="-1")
entwine_2 = Entwine(Branch00=cir_a_3, Branch01=move_5.Geometry, Branch02=crv_7, FlattenInputs=True)  # -> flatten(Result)
project = ProjectPoint(Point=pt_4, Direction=Z_8, Geometry=loft)  # -> Point, Index
project_2 = ProjectPoint(Point=pt_2, Direction=Z_9, Geometry=loft)  # -> Point, Index
project_3 = ProjectPoint(Point=pt_3, Direction=Z_7, Geometry=loft)  # -> Point, Index
pt_6 = Point(project.Point)
pt_7 = Point(project_2.Point)
pt_8 = Point(project_3.Point)
ln_6 = Line(StartPoint=pt_3, EndPoint=project_3.Point)
ln_7 = Line(StartPoint=project.Point, EndPoint=end_2.End)
shift_3 = ShiftList(List=pt_6, Shift=1, Wrap=True)
ln_8 = Line(StartPoint=pt_2, EndPoint=project_2.Point)
shift_4 = ShiftList(List=pt_6, Shift="-1", Wrap=True)
loft_2 = Loft(Curves=entwine_2, Options={Adjust=False, Closed=False, LoftEnds=0, LoftSimp=0, LoftType=0, Rebuild=10, Refit=0.01})
crv_11 = Curve(ln_6)
crv_12 = Curve(ln_7)
ln_9 = Line(StartPoint=pt_5, EndPoint=shift_3)
ln_10 = Line(StartPoint=pt_5, EndPoint=shift_4)
crv_13 = Curve(ln_8)
pipe_2 = Pipe(Curve=[crv_13, crv_11, crv_12, ln_3], Radius=Slider(0.08, range=0..0.3), Caps=0)
pipe_3 = Pipe(Curve=[ln_4, ln_5], Radius=Slider(0.15, range=0..0.3), Caps=Slider(1, range=0..2))
shift_5 = ShiftList(List=crv_11, Shift=1, Wrap=True)
shift_6 = ShiftList(List=crv_11, Shift="-1", Wrap=True)
shift_7 = ShiftList(List=pt_4, Shift=1, Wrap=True)
shift_8 = ShiftList(List=crv_11, Shift=1, Wrap=True)
shift_9 = ShiftList(List=pt, Shift=1, Wrap=True)
shift_10 = ShiftList(List=crv_11, Shift="-1", Wrap=True)
shift_11 = ShiftList(List=pt, Shift="-1", Wrap=True)
pt_9 = Point(move_4.Geometry)
crv_14 = Curve(ln_9)
end_3 = EndPoints(Curve=crv_12)  # -> Start, End
end_4 = EndPoints(Curve=shift_5)  # -> Start, End
end_5 = EndPoints(Curve=crv_12)  # -> Start, End
end_6 = EndPoints(Curve=shift_6)  # -> Start, End
end_7 = EndPoints(Curve=crv_13)  # -> Start, End
end_8 = EndPoints(Curve=crv_13)  # -> Start, End
end_9 = EndPoints(Curve=crv_13)  # -> Start, End
end_10 = EndPoints(Curve=shift_8)  # -> Start, End
end_11 = EndPoints(Curve=crv_13)  # -> Start, End
end_12 = EndPoints(Curve=shift_10)  # -> Start, End
ln_11 = Line(StartPoint=end_4.Start, EndPoint=end_5.Start)
ln_12 = Line(StartPoint=end_3.Start, EndPoint=end_6.Start)
ln_13 = Line(StartPoint=end_10.End, EndPoint=end_11.Start)
ln_14 = Line(StartPoint=shift_9, EndPoint=end_8.End)
ln_15 = Line(StartPoint=end_9.Start, EndPoint=end_12.End)
ln_16 = Line(StartPoint=shift_11, EndPoint=end_7.End)
shift_12 = ShiftList(List=pt_9, Shift=1, Wrap=True)
ln_17 = Line(StartPoint=pt_4, EndPoint=shift_12)
ln_18 = Line(StartPoint=pt_9, EndPoint=shift_7)
crv_15 = Curve(ln_18)
llx = LineLine(Line1=crv_14, Line2=crv_15)  # -> ParamA, ParamB, PointA, PointB
pt_10 = Point(llx.PointA)
crv_16 = Curve(ln_10)
pipe_4 = Pipe(Curve=[ln_15, ln_13, ln_12, ln_11, ln_16, ln_14], Radius=Slider(0.08, range=0..0.3), Caps=0)
crv_17 = Curve(ln_17)
llx_2 = LineLine(Line1=ln_18, Line2=ln_17)  # -> ParamA, ParamB, PointA, PointB
boundary = BoundarySurfaces(Edges=flatten(offset_5))
shift_13 = ShiftList(List=crv_17, Shift="-1", Wrap=True)
llx_3 = LineLine(Line1=crv_16, Line2=shift_13)  # -> ParamA, ParamB, PointA, PointB
pt_11 = Point(llx_2.PointA)
Z_10 = UnitZ(Factor=graft(["1", "-1"]))
pt_12 = Point(llx_3.PointA)
line_2 = LineSDL(Start=pt_11, Direction=Z_10, Length=1)
Z_11 = UnitZ(Factor=graft(["1", "-1"]))
flip = FlipMatrix(Data=line_2)
crv_18 = Curve(line)
line_3 = LineSDL(Start=pt_10, Direction=Z_11, Length=Slider(0.3, range=0..1))
join_3 = JoinCurves(Curves=flip, Preserve=False)  # -> flatten(Curves)
Z_12 = UnitZ(Factor=graft(["1", "-1"]))
flip_2 = FlipCurve(Curve=crv_18)  # -> Curve, Flag
flip_3 = FlipMatrix(Data=line_3)
line_4 = LineSDL(Start=pt_12, Direction=Z_12, Length=Slider(0.3, range=0..1))
shift_14 = ShiftList(List=flip_2.Curve, Shift=1, Wrap=True)
entwine_3 = Entwine(Branch00=join_3, Branch01=shift_14, FlattenInputs=True)
entwine_4 = Entwine(Branch00=flip_2.Curve, Branch01=join_3, FlattenInputs=True)
crv_19 = Curve(ln_7)
flip_4 = FlipMatrix(Data=entwine_3)
flip_5 = FlipMatrix(Data=line_4)
flip_6 = FlipMatrix(Data=entwine_4)
join_4 = JoinCurves(Curves=flip_3, Preserve=False)  # -> flatten(Curves)
join_5 = JoinCurves(Curves=flip_5, Preserve=False)  # -> flatten(Curves)
loft_3 = Loft(Curves=flip_6, Options={Adjust=False, Closed=False, LoftEnds=0, LoftSimp=0, LoftType=0, Rebuild=10, Refit=0.01})  # -> flatten(Loft)
flip_7 = FlipCurve(Curve=join_4)  # -> Curve, Flag
shift_15 = ShiftList(List=crv_19, Shift="-1", Wrap=True)
loft_4 = Loft(Curves=flip_4, Options={Adjust=False, Closed=False, LoftEnds=0, LoftSimp=0, LoftType=0, Rebuild=10, Refit=0.01})  # -> flatten(Loft)
flip_8 = FlipCurve(Curve=join_5)  # -> Curve, Flag
shift_16 = ShiftList(List=crv_19, Shift=1, Wrap=True)
entwine_5 = Entwine(Branch00=flip_8.Curve, Branch01=shift_15, FlattenInputs=True)
edges = BrepEdges(Brep=loft_3)  # -> Naked, Interior, NonManifold
edges_2 = BrepEdges(Brep=loft_4)  # -> Naked, Interior, NonManifold
entwine_6 = Entwine(Branch00=flip_7.Curve, Branch01=shift_16, FlattenInputs=True)
number_slider_2 = Slider(6, range=3..7)
pipe_5 = Pipe(Curve=[ln_18, ln_17, crv_16, crv_17, crv_14], Radius=Slider(0.08, range=0..0.3), Caps=0)
number_slider_3 = Slider(6, range=3..7)
item = ListItem(List=edges_2.Naked, Index=["0", "2"], Wrap=True)
item_2 = ListItem(List=edges.Naked, Index=["0", "2"], Wrap=True)
flip_9 = FlipMatrix(Data=entwine_5)
divide_5 = DivideCurve(Curve=item_2, Count=number_slider_2, Kinks=False)  # -> Points, Tangents, Parameters
flip_10 = FlipMatrix(Data=entwine_6)
divide_6 = DivideCurve(Curve=item, Count=number_slider_3, Kinks=False)  # -> Points, Tangents, Parameters
dom = ConstructDomain(DomainStart="1", DomainEnd=expr("x - 1", number_slider_2))
dom_2 = ConstructDomain(DomainStart="1", DomainEnd=expr("x -1", number_slider_3))
subset = SubList(List=divide_5.Points, Domain=dom, Wrap=True)  # -> simplify(List), Index
viewer = ParamViewer(subset.List)
subset_2 = SubList(List=divide_6.Points, Domain=dom_2, Wrap=True)  # -> simplify(List), Index
loft_5 = Loft(Curves=flip_10, Options={Adjust=False, Closed=False, LoftEnds=0, LoftSimp=0, LoftType=0, Rebuild=10, Refit=0.01})  # -> flatten(Loft)
loft_6 = Loft(Curves=flip_9, Options={Adjust=False, Closed=False, LoftEnds=0, LoftSimp=0, LoftType=0, Rebuild=10, Refit=0.01})  # -> flatten(Loft)
path_mapper = PathMapper(subset_2.List, source="{A;1}", target="{1;A}")
path_mapper_2 = PathMapper(subset_2.List, source="{A;2}", target="{2;A}")
path_mapper_3 = PathMapper(subset.List, source="{A;0}", target="{0;A}")
path_mapper_4 = PathMapper(subset.List, source="{A;1}", target="{1;A}")
dom_3 = ConstructDomain(DomainStart=expr("x - 1", "1"), DomainEnd=expr("x - 2", number_slider_2))
pt_13 = Point(path_mapper_3)
pt_14 = Point(path_mapper_4)
edges_3 = BrepEdges(Brep=loft_5)  # -> Naked, Interior, NonManifold
viewer_2 = ParamViewer(pt_14)
viewer_3 = ParamViewer(pt_13)
dom_4 = ConstructDomain(DomainStart=expr("x - 1", "1"), DomainEnd=expr("x - 2", number_slider_3))
edges_4 = BrepEdges(Brep=loft_6)  # -> Naked, Interior, NonManifold
dom_5 = ConstructDomain(DomainStart=expr("x - 1", number_slider_2), DomainEnd=expr("2 * (x - 1) - 1", number_slider_2))
dom_6 = ConstructDomain(DomainStart=expr("x - 1", number_slider_3), DomainEnd=expr("2 * (x - 1) - 1", number_slider_3))
subset_3 = SubList(List=pt_13, Domain=dom_3, Wrap=True)  # -> List, Index
subset_4 = SubList(List=pt_14, Domain=dom_5, Wrap=True)  # -> List, Index
subset_5 = SubList(List=path_mapper, Domain=dom_4, Wrap=True)  # -> List, Index
subset_6 = SubList(List=path_mapper_2, Domain=dom_6, Wrap=True)  # -> List, Index
number_slider_4 = Slider(5, range=3..7)
number_slider_5 = Slider(5, range=3..7)
item_3 = ListItem(List=edges_4.Naked, Index=["0", "2"], Wrap=True)
item_4 = ListItem(List=edges_3.Naked, Index=["0", "2"], Wrap=True)
rev = ReverseList(List=subset_4.List)
rev_2 = ReverseList(List=subset_6.List)
ln_19 = Line(StartPoint=subset_3.List, EndPoint=rev)
ln_20 = Line(StartPoint=subset_5.List, EndPoint=rev_2)
divide_7 = DivideCurve(Curve=item_4, Count=number_slider_4, Kinks=False)  # -> Points, Tangents, Parameters
divide_8 = DivideCurve(Curve=item_3, Count=number_slider_5, Kinks=False)  # -> Points, Tangents, Parameters
midpt = CurveMiddle(Curve=ln_20)
viewer_4 = ParamViewer(subset_3.List)
midpt_2 = CurveMiddle(Curve=ln_19)
viewer_5 = ParamViewer(subset_4.List)
dom_7 = ConstructDomain(DomainStart="1", DomainEnd=expr("x - 1", number_slider_4))
dom_8 = ConstructDomain(DomainStart="1", DomainEnd=expr("x -1", number_slider_5))
Z_13 = UnitZ(Factor=expr("- x", Slider(1, range=0..4)))
subset_7 = SubList(List=divide_7.Points, Domain=dom_7, Wrap=True)  # -> simplify(List), Index
subset_8 = SubList(List=divide_8.Points, Domain=dom_8, Wrap=True)  # -> simplify(List), Index
move_6 = Move(Geometry=midpt, Motion=Z_13)  # -> Geometry, Transform
Z_14 = UnitZ(Factor=expr("- x", Slider(1, range=0..4)))
move_7 = Move(Geometry=midpt_2, Motion=Z_14)  # -> Geometry, Transform
scale = Scale(Geometry=ln_20, Center=move_6.Geometry, Factor=Slider(1.33, range=1..1.7))  # -> Geometry, Transform
scale_2 = Scale(Geometry=ln_19, Center=move_7.Geometry, Factor=Slider(1.33, range=1..1.7))  # -> Geometry, Transform
path_mapper_5 = PathMapper(subset_7.List, source="{A;0}", target="{0;A}")
path_mapper_6 = PathMapper(subset_7.List, source="{A;1}", target="{1;A}")
dom_9 = ConstructDomain(DomainStart=expr("x - 1", "1"), DomainEnd=expr("x - 2", number_slider_4))
path_mapper_7 = PathMapper(subset_8.List, source="{A;1}", target="{1;A}")
path_mapper_8 = PathMapper(subset_8.List, source="{A;2}", target="{2;A}")
pt_15 = Point(path_mapper_5)
pt_16 = Point(path_mapper_6)
dom_10 = ConstructDomain(DomainStart=expr("x - 1", "1"), DomainEnd=expr("x - 2", number_slider_5))
pipe_6 = Pipe(Curve=[scale_2.Geometry, scale.Geometry], Radius=Slider(0.06, range=0..0.3), Caps=0)
dom_11 = ConstructDomain(DomainStart=expr("x - 1", number_slider_4), DomainEnd=expr("2 * (x - 1) - 1", number_slider_4))
dom_12 = ConstructDomain(DomainStart=expr("x - 1", number_slider_5), DomainEnd=expr("2 * (x - 1) - 1", number_slider_5))
subset_9 = SubList(List=pt_15, Domain=dom_9, Wrap=True)  # -> List, Index
subset_10 = SubList(List=pt_16, Domain=dom_11, Wrap=True)  # -> List, Index
subset_11 = SubList(List=path_mapper_7, Domain=dom_10, Wrap=True)  # -> List, Index
subset_12 = SubList(List=path_mapper_8, Domain=dom_12, Wrap=True)  # -> List, Index
rev_3 = ReverseList(List=subset_10.List)
rev_4 = ReverseList(List=subset_12.List)
ln_21 = Line(StartPoint=subset_9.List, EndPoint=rev_3)
ln_22 = Line(StartPoint=subset_11.List, EndPoint=rev_4)
midpt_3 = CurveMiddle(Curve=ln_22)
midpt_4 = CurveMiddle(Curve=ln_21)
Z_15 = UnitZ(Factor=expr("- x", Slider(1, range=0..4)))
move_8 = Move(Geometry=midpt_3, Motion=Z_15)  # -> Geometry, Transform
Z_16 = UnitZ(Factor=expr("- x", Slider(0.36, range=0..4)))
scale_3 = Scale(Geometry=ln_22, Center=move_8.Geometry, Factor=Slider(1.33, range=1..1.7))  # -> Geometry, Transform
move_9 = Move(Geometry=midpt_4, Motion=Z_16)  # -> Geometry, Transform
scale_4 = Scale(Geometry=ln_21, Center=move_9.Geometry, Factor=Slider(1.38, range=1..1.7))  # -> Geometry, Transform
pipe_7 = Pipe(Curve=[ln_21, ln_22, scale_4.Geometry, scale_3.Geometry], Radius=Slider(0.06, range=0..0.3), Caps=0)
brep = Brep(boundary)
material = CreateMaterial(
    Diffuse=ColourSwatch(SwatchColor=RGB(255, 254, 254)),
    Specular=RGB(255, 254, 254),
    Emission=RGB(0, 0, 0),
    Transparency=0,
    Shine=0)
brep_2 = Brep(brep)
brep_3 = Brep(pipe_5)
brep_4 = Brep(pipe_3)
brep_5 = Brep(pipe_7)
brep_6 = Brep(pipe_6)
brep_7 = Brep(loft_2)
brep_8 = Brep(pipe)
brep_9 = Brep(pipe_4)
brep_10 = Brep(pipe_2)
geo = Geometry([brep_5, brep_6, brep_3, brep_4, brep_8, brep_9, brep_10, brep_7, brep_2])
preview = CustomPreview(Geometry=geo, Material=material)  # disabled

# ==== cluster VersionCreate: 自动更新
D = ClusterInput()  # type
bang = ExplodeTree(Data=graft(D))  # -> Branch0, Branch1
T = Text(bang.Branch0)
entwine = Entwine(Branch00=bang.Branch1, Branch01=".", FlattenInputs=True)  # -> flatten(Result)
tmatch = MatchText(Text=T, Pattern=" ", Case=True)
join = TextJoin(Text=entwine)
P = ClusterInput()
p_n_c = PickNChoose(Pattern=tmatch, Stream0=T, Stream1=join)
D_2 = ClusterInput()
V = ClusterInput()
P_2 = Text(P)
V_2 = Integer(V)
D_3 = Integer(D_2)
entwine_2 = Entwine(Branch00=P_2, Branch02="Ver-", Branch03=p_n_c, Branch04=V_2, Branch05=".", Branch06=D_3, FlattenInputs=True)  # -> flatten(Result)
join_2 = TextJoin(Text=entwine_2)
R = ClusterOutput(join_2)
