# Grasshopper definition Candelabrum ALPHA.2.ghx (Grasshopper 1.0.7)

knob = ControlKnob(Decimals=0, Limit=True, Maximum=99, Minimum=0, Range=10, Value=0)
list = ValueList({"ALPHA": "ALPHA.a.", "Beta": "Beta.0.", "Stable": " "}, selected="ALPHA")
ver = VersionCreate(P="「Candelabrum」", D=[list, Slider(1, range=1..9)], V=Slider(2, range=0..9), D_2=knob)
panel = Panel(ver)

# ----
# 裙草图
number_slider = Slider(5, range=0..10)
cir = Circle(Plane=PlaneXY(0, 0, 0), Radius=number_slider)
Z = UnitZ(Factor=Slider(10, range=0..10))
move = Move(Geometry=cir, Motion=Z)  # -> Geometry, Transform
panel_2 = Panel("16")

# ---- group: A
cir_a = Curve(move.Geometry)

# ----
multiplication = Multiplication(A=number_slider, B=Slider(2.5, range=0..5))
offset = OffsetCurve(Curve=cir_a, Distance=multiplication, Corners=1)
Z_2 = UnitZ(Factor=Slider(-2, range=-5..0))
move_2 = Move(Geometry=offset, Motion=Z_2)  # -> Geometry, Transform

offset_2 = OffsetCurve(Curve=cir_a, Distance=Slider(-1.4, range=-3..3), Corners=1)
Z_3 = UnitZ(Factor=Slider(0.2, range=0..2))
move_3 = Move(Geometry=offset_2, Motion=Z_3)  # -> Geometry, Transform

# ---- group: B
cir_a_2 = Curve(move_2.Geometry)

# ---- group: 1
crv = Curve(move_3.Geometry)

# ----
series = Series(Start=0, Step=1, Count=Slider(6, range=0..7))
bnd = Bounds(Numbers=series)
remap = RemapNumbers(Value=series, Source=bnd, Target=Domain(0, 1))  # -> Mapped, Clipped
graph = GraphMapper(
    remap.Mapped,
    x0=0,
    x1=1,
    y0=0,
    y1=10,
    container_name="Bezier",
    cpx=[0, 0.807466805, 0.2748494148, 1],
    cpy=[0, 0.2821345925, 0, 1])
split = SplitList(List=graph, Index="1")  # -> ListA, ListB
offset_3 = OffsetCurve(Curve=crv, Distance=split.ListB, Corners=1)  # -> simplify(Curve)
bang = ExplodeTree(Data=offset_3)  # -> Branch0, Branch1, Branch2, Branch3, Branch4

# ---- group: 2
crv_2 = Curve(bang.Branch0)

# ---- group: 3
crv_3 = Curve(bang.Branch1)

# ---- group: 4
crv_4 = Curve(bang.Branch2)

# ---- group: 5
crv_5 = Curve(bang.Branch3)

# ---- group: 6
crv_6 = Curve(bang.Branch4)

# ----
# 裙边加工
panel_3 = Panel("1")

# ---- group: B
cir_a_3 = Curve(cir_a_2)

# ---- group: 1
cir_a_4 = Curve(crv)

# ---- group: 2
crv_7 = Curve(crv_2)

# ----
# 裙边立剑
panel_4 = Panel("16")
divide = DivideCurve(Curve=cir_a_3, Count="16", Kinks=False)  # -> Points, Tangents, Parameters
divide_2 = DivideCurve(Curve=crv_7, Count=panel_4, Kinks=False)  # -> Points, Tangents, Parameters
pt = Point(divide.Points)
ln = Line(StartPoint=divide.Points, EndPoint=divide_2.Points)
loft = Loft(Curves=ln, Options={Adjust=False, Closed=True, LoftEnds=0, LoftSimp=0, LoftType=0, Rebuild=10, Refit=0.01})
Z_4 = UnitZ(Factor="1")
line = LineSDL(Start=divide.Points, Direction=Z_4, Length=Slider(5.9, range=0..8))
end = EndPoints(Curve=line)  # -> Start, End
brep = Brep(loft)

pt_2 = Point(pt)

number_slider_2 = Slider(16, range=1..50)
entwine = Entwine(Branch00=crv_3, Branch01=crv_4, Branch02=crv_5, Branch03=crv_6, FlattenInputs=True)

reb = RebuildCurve(Curve=entwine, Degree=panel_3, Count=number_slider_2, Tangents=False)
reb_2 = RebuildCurve(Curve=cir_a, Degree=panel_3, Count=number_slider_2, Tangents=False)
cp = ControlPoints(Curve=reb)  # -> Points, Weights, Knots
cullpt = CullDuplicates(Points=cp.Points, Tolerance=0.1, CullMode=3)  # -> Points, Indices, Valence

# ---- group: A
cir_a_5 = Curve(reb_2)

# ----
bang_2 = ExplodeTree(Data=simplify(cullpt.Points))  # -> Branch0, Branch1, Branch2, Branch3
bang_3 = ExplodeTree(Data=simplify(reb))  # -> Branch0, Branch1, Branch2, Branch3

# ---- group: 3
crv_8 = Curve(bang_3.Branch0)
pt_3 = Point(bang_2.Branch0)

# ---- group: 4
pt_4 = Point(bang_2.Branch1)
crv_9 = Curve(bang_3.Branch1)

# ---- group: 5
pt_5 = Point(bang_2.Branch2)
crv_10 = Curve(bang_3.Branch2)

# ---- group: 6
pt_6 = Point(bang_2.Branch3)
crv_11 = Curve(bang_3.Branch3)

# ----
# 中间回转边
number_slider_3 = Slider(-0.07, range=-1..0)
offset_4 = OffsetCurve(Curve=crv_7, Distance=number_slider_3, Corners=1)
Z_5 = UnitZ(Factor=Slider(0.1, range=0..1))
move_4 = Move(Geometry=offset_4, Motion=Z_5)  # -> Geometry, Transform
entwine_2 = Entwine(Branch00=cir_a_5, Branch01=move_4.Geometry, Branch02=crv_8, FlattenInputs=True)  # -> flatten(Result)
loft_2 = Loft(Curves=entwine_2, Options={Adjust=False, Closed=False, LoftEnds=0, LoftSimp=0, LoftType=0, Rebuild=10, Refit=0.01})

brep_2 = Brep(brep)
pt_7 = Point(pt_5)
pt_8 = Point(pt_6)
# 裙撑骨架
pt_9 = Point(pt_4)
Z_6 = UnitZ(Factor="-1")
Z_7 = UnitZ(Factor="-1")
Z_8 = UnitZ(Factor="-1")
project = ProjectPoint(Point=pt_7, Direction=Z_6, Geometry=brep_2)  # -> Point, Index
project_2 = ProjectPoint(Point=pt_8, Direction=Z_7, Geometry=brep_2)  # -> Point, Index
project_3 = ProjectPoint(Point=pt_9, Direction=Z_8, Geometry=brep_2)  # -> Point, Index
ln_2 = Line(StartPoint=project_2.Point, EndPoint=pt_8)
ln_3 = Line(StartPoint=pt_7, EndPoint=project.Point)
ln_4 = Line(StartPoint=pt_9, EndPoint=project_3.Point)

crv_12 = Curve(ln_4)
# 裙撑编织
pt_10 = Point(pt_3)
crv_13 = Curve(ln_3)
crv_14 = Curve(ln_2)

pt_11 = Point(pt_6)

crv_15 = Curve(crv_13)
crv_16 = Curve(crv_14)
shift = ShiftList(List=crv_15, Shift="-1", Wrap=True)
shift_2 = ShiftList(List=crv_15, Shift=1, Wrap=True)
end_2 = EndPoints(Curve=shift)  # -> Start, End
end_3 = EndPoints(Curve=crv_16)  # -> Start, End
end_4 = EndPoints(Curve=shift_2)  # -> Start, End
end_5 = EndPoints(Curve=crv_16)  # -> Start, End
ln_5 = Line(StartPoint=end_2.Start, EndPoint=end_3.Start)
ln_6 = Line(StartPoint=end_4.Start, EndPoint=end_5.Start)

pt_12 = Point(pt_2)
pt_13 = Point(pt_11)
shift_3 = ShiftList(List=pt_12, Shift="0", Wrap=True)
shift_4 = ShiftList(List=pt_13, Shift="-2", Wrap=True)
ln_7 = Line(StartPoint=pt_13, EndPoint=shift_3)
ln_8 = Line(StartPoint=pt_12, EndPoint=shift_4)

crv_17 = Curve(crv_13)
crv_18 = Curve(crv_12)
shift_5 = ShiftList(List=crv_17, Shift=1, Wrap=True)
shift_6 = ShiftList(List=crv_17, Shift="-1", Wrap=True)
end_6 = EndPoints(Curve=crv_18)  # -> Start, End
end_7 = EndPoints(Curve=shift_6)  # -> Start, End
end_8 = EndPoints(Curve=shift_5)  # -> Start, End
end_9 = EndPoints(Curve=crv_18)  # -> Start, End
ln_9 = Line(StartPoint=end_8.End, EndPoint=end_9.Start)
ln_10 = Line(StartPoint=end_7.End, EndPoint=end_6.Start)

crv_19 = Curve(crv_12)
shift_7 = ShiftList(List=pt_10, Shift="-1", Wrap=True)
shift_8 = ShiftList(List=pt_10, Shift=1, Wrap=True)
end_10 = EndPoints(Curve=crv_19)  # -> Start, End
end_11 = EndPoints(Curve=crv_19)  # -> Start, End
ln_11 = Line(StartPoint=shift_7, EndPoint=end_10.End)
ln_12 = Line(StartPoint=shift_8, EndPoint=end_11.End)

pt_14 = Point(project_2.Point)
# 内风格线
pt_15 = Point(end.End)
shift_9 = ShiftList(List=pt_14, Shift=Slider(-2, range=-3..3), Wrap=True)
shift_10 = ShiftList(List=pt_14, Shift=Slider(0, range=-3..3), Wrap=True)
ln_13 = Line(StartPoint=pt_15, EndPoint=shift_9)
ln_14 = Line(StartPoint=pt_15, EndPoint=shift_10)
crv_20 = Curve(ln_2)
crv_21 = Curve(ln_8)
crv_22 = Curve(ln_7)
crv_23 = Curve(ln_13)
crv_24 = Curve(ln_14)
shift_11 = ShiftList(List=crv_22, Shift=Slider(0, range=-3..3), Wrap=True)
llx = LineLine(Line1=crv_23, Line2=crv_21)  # -> ParamA, ParamB, PointA, PointB
llx_2 = LineLine(Line1=shift_11, Line2=crv_24)  # -> ParamA, ParamB, PointA, PointB
pt_16 = Point(llx_2.PointA)
Z_9 = UnitZ(Factor=graft(["1", "-1"]))
pt_17 = Point(llx.PointA)
line_2 = LineSDL(Start=pt_16, Direction=Z_9, Length=Slider(0.3, range=0..1))
Z_10 = UnitZ(Factor=graft(["1", "-1"]))
flip = FlipMatrix(Data=line_2)
line_3 = LineSDL(Start=pt_17, Direction=Z_10, Length=Slider(0.3, range=0..1))
crv_25 = Curve(crv_20)
flip_2 = FlipMatrix(Data=line_3)
join = JoinCurves(Curves=flip, Preserve=False)  # -> flatten(Curves)
shift_12 = ShiftList(List=crv_25, Shift=Slider(0, range=-3..3), Wrap=True)
join_2 = JoinCurves(Curves=flip_2, Preserve=False)  # -> flatten(Curves)
shift_13 = ShiftList(List=crv_25, Shift=Slider(-2, range=-3..3), Wrap=True)

# ----
# 外风格线
crv_26 = Curve(ln_7)
crv_27 = Curve(ln_8)
shift_14 = ShiftList(List=crv_27, Shift=Slider(1, range=-3..3), Wrap=True)
llx_3 = LineLine(Line1=shift_14, Line2=crv_26)  # -> ParamA, ParamB, PointA, PointB
Z_11 = UnitZ(Factor=graft(["1", "-1"]))
pt_18 = Point(llx_3.PointA)
line_4 = LineSDL(Start=pt_18, Direction=Z_11, Length=1)

flip_3 = FlipMatrix(Data=line_4)
crv_28 = Curve(line)
flip_4 = FlipCurve(Curve=crv_28)  # -> Curve, Flag
join_3 = JoinCurves(Curves=flip_3, Preserve=False)  # -> flatten(Curves)
shift_15 = ShiftList(List=flip_4.Curve, Shift=1, Wrap=True)
entwine_3 = Entwine(Branch00=join_3, Branch01=shift_15, FlattenInputs=True)
entwine_4 = Entwine(Branch00=flip_4.Curve, Branch01=join_3, FlattenInputs=True)
flip_5 = FlipMatrix(Data=entwine_3)
flip_6 = FlipMatrix(Data=entwine_4)
loft_3 = Loft(Curves=flip_6, Options={Adjust=False, Closed=False, LoftEnds=0, LoftSimp=0, LoftType=0, Rebuild=10, Refit=0.01})  # -> flatten(Loft)
loft_4 = Loft(Curves=flip_5, Options={Adjust=False, Closed=False, LoftEnds=0, LoftSimp=0, LoftType=0, Rebuild=10, Refit=0.01})  # -> flatten(Loft)
edges = BrepEdges(Brep=loft_3)  # -> Naked, Interior, NonManifold
edges_2 = BrepEdges(Brep=loft_4)  # -> Naked, Interior, NonManifold
number_slider_4 = Slider(6, range=3..7)
number_slider_5 = Slider(6, range=3..7)
item = ListItem(List=edges_2.Naked, Index=["0", "2"], Wrap=True)
item_2 = ListItem(List=edges.Naked, Index=["0", "2"], Wrap=True)
divide_3 = DivideCurve(Curve=item_2, Count=number_slider_4, Kinks=False)  # -> Points, Tangents, Parameters
divide_4 = DivideCurve(Curve=item, Count=number_slider_5, Kinks=False)  # -> Points, Tangents, Parameters
dom = ConstructDomain(DomainStart="1", DomainEnd=expr("x - 1", number_slider_4))
dom_2 = ConstructDomain(DomainStart="1", DomainEnd=expr("x -1", number_slider_5))
subset = SubList(List=divide_3.Points, Domain=dom, Wrap=True)  # -> simplify(List), Index
subset_2 = SubList(List=divide_4.Points, Domain=dom_2, Wrap=True)  # -> simplify(List), Index
path_mapper = PathMapper(subset_2.List, source="{A;1}", target="{1;A}")
path_mapper_2 = PathMapper(subset_2.List, source="{A;2}", target="{2;A}")
path_mapper_3 = PathMapper(subset.List, source="{A;0}", target="{0;A}")
path_mapper_4 = PathMapper(subset.List, source="{A;1}", target="{1;A}")
dom_3 = ConstructDomain(DomainStart=expr("x - 1", "1"), DomainEnd=expr("x - 2", number_slider_4))
pt_19 = Point(path_mapper_3)
pt_20 = Point(path_mapper_4)
dom_4 = ConstructDomain(DomainStart=expr("x - 1", "1"), DomainEnd=expr("x - 2", number_slider_5))
dom_5 = ConstructDomain(DomainStart=expr("x - 1", number_slider_4), DomainEnd=expr("2 * (x - 1) - 1", number_slider_4))
dom_6 = ConstructDomain(DomainStart=expr("x - 1", number_slider_5), DomainEnd=expr("2 * (x - 1) - 1", number_slider_5))
subset_3 = SubList(List=pt_19, Domain=dom_3, Wrap=True)  # -> List, Index
subset_4 = SubList(List=pt_20, Domain=dom_5, Wrap=True)  # -> List, Index
subset_5 = SubList(List=path_mapper, Domain=dom_4, Wrap=True)  # -> List, Index
subset_6 = SubList(List=path_mapper_2, Domain=dom_6, Wrap=True)  # -> List, Index
rev = ReverseList(List=subset_4.List)
rev_2 = ReverseList(List=subset_6.List)
ln_15 = Line(StartPoint=subset_3.List, EndPoint=rev)
ln_16 = Line(StartPoint=subset_5.List, EndPoint=rev_2)
midpt = CurveMiddle(Curve=ln_16)
midpt_2 = CurveMiddle(Curve=ln_15)
Z_12 = UnitZ(Factor=expr("- x", Slider(1, range=0..4)))
move_5 = Move(Geometry=midpt, Motion=Z_12)  # -> Geometry, Transform
Z_13 = UnitZ(Factor=expr("- x", Slider(1, range=0..4)))
move_6 = Move(Geometry=midpt_2, Motion=Z_13)  # -> Geometry, Transform
scale = Scale(Geometry=ln_16, Center=move_5.Geometry, Factor=Slider(1.33, range=1..1.7))  # -> Geometry, Transform
scale_2 = Scale(Geometry=ln_15, Center=move_6.Geometry, Factor=Slider(1.33, range=1..1.7))  # -> Geometry, Transform
pipe = Pipe(Curve=[scale_2.Geometry, scale.Geometry], Radius=Slider(0.06, range=0..0.3), Caps=0)

flip_7 = FlipCurve(Curve=join_2)  # -> Curve, Flag
flip_8 = FlipCurve(Curve=join)  # -> Curve, Flag
entwine_5 = Entwine(Branch00=flip_8.Curve, Branch01=shift_12, FlattenInputs=True)
entwine_6 = Entwine(Branch00=flip_7.Curve, Branch01=shift_13, FlattenInputs=True)
flip_9 = FlipMatrix(Data=entwine_5)
flip_10 = FlipMatrix(Data=entwine_6)
loft_5 = Loft(Curves=flip_10, Options={Adjust=False, Closed=False, LoftEnds=0, LoftSimp=0, LoftType=0, Rebuild=10, Refit=0.01})  # -> flatten(Loft)
loft_6 = Loft(Curves=flip_9, Options={Adjust=False, Closed=False, LoftEnds=0, LoftSimp=0, LoftType=0, Rebuild=10, Refit=0.01})  # -> flatten(Loft)
edges_3 = BrepEdges(Brep=loft_6)  # -> Naked, Interior, NonManifold
edges_4 = BrepEdges(Brep=loft_5)  # -> Naked, Interior, NonManifold
number_slider_6 = Slider(5, range=3..7)
number_slider_7 = Slider(5, range=3..7)
item_3 = ListItem(List=edges_4.Naked, Index=["0", "2"], Wrap=True)
item_4 = ListItem(List=edges_3.Naked, Index=["0", "2"], Wrap=True)
divide_5 = DivideCurve(Curve=item_4, Count=number_slider_6, Kinks=False)  # -> Points, Tangents, Parameters
divide_6 = DivideCurve(Curve=item_3, Count=number_slider_7, Kinks=False)  # -> Points, Tangents, Parameters
dom_7 = ConstructDomain(DomainStart="1", DomainEnd=expr("x - 1", number_slider_6))
dom_8 = ConstructDomain(DomainStart="1", DomainEnd=expr("x -1", number_slider_7))
subset_7 = SubList(List=divide_5.Points, Domain=dom_7, Wrap=True)  # -> simplify(List), Index
subset_8 = SubList(List=divide_6.Points, Domain=dom_8, Wrap=True)  # -> simplify(List), Index
path_mapper_5 = PathMapper(subset_7.List, source="{A;0}", target="{0;A}")
path_mapper_6 = PathMapper(subset_7.List, source="{A;1}", target="{1;A}")
dom_9 = ConstructDomain(DomainStart=expr("x - 1", "1"), DomainEnd=expr("x - 2", number_slider_6))
path_mapper_7 = PathMapper(subset_8.List, source="{A;1}", target="{1;A}")
path_mapper_8 = PathMapper(subset_8.List, source="{A;2}", target="{2;A}")
pt_21 = Point(path_mapper_5)
dom_10 = ConstructDomain(DomainStart=expr("x - 1", "1"), DomainEnd=expr("x - 2", number_slider_7))
pt_22 = Point(path_mapper_6)
dom_11 = ConstructDomain(DomainStart=expr("x - 1", number_slider_6), DomainEnd=expr("2 * (x - 1) - 1", number_slider_6))
dom_12 = ConstructDomain(DomainStart=expr("x - 1", number_slider_7), DomainEnd=expr("2 * (x - 1) - 1", number_slider_7))
subset_9 = SubList(List=pt_21, Domain=dom_9, Wrap=True)  # -> List, Index
subset_10 = SubList(List=pt_22, Domain=dom_11, Wrap=True)  # -> List, Index
subset_11 = SubList(List=path_mapper_7, Domain=dom_10, Wrap=True)  # -> List, Index
subset_12 = SubList(List=path_mapper_8, Domain=dom_12, Wrap=True)  # -> List, Index
rev_3 = ReverseList(List=subset_10.List)
rev_4 = ReverseList(List=subset_12.List)
ln_17 = Line(StartPoint=subset_9.List, EndPoint=rev_3)
ln_18 = Line(StartPoint=subset_11.List, EndPoint=rev_4)
midpt_3 = CurveMiddle(Curve=ln_18)
midpt_4 = CurveMiddle(Curve=ln_17)
Z_14 = UnitZ(Factor=expr("- x", Slider(0.36, range=0..4)))
move_7 = Move(Geometry=midpt_3, Motion=Z_14)  # -> Geometry, Transform
Z_15 = UnitZ(Factor=expr("- x", Slider(0.36, range=0..4)))
scale_3 = Scale(Geometry=ln_18, Center=move_7.Geometry, Factor=Slider(1.38, range=1..1.7))  # -> Geometry, Transform
move_8 = Move(Geometry=midpt_4, Motion=Z_15)  # -> Geometry, Transform
scale_4 = Scale(Geometry=ln_17, Center=move_8.Geometry, Factor=Slider(1.38, range=1..1.7))  # -> Geometry, Transform
pipe_2 = Pipe(Curve=[scale_4.Geometry, scale_3.Geometry], Radius=Slider(0.06, range=0..0.3), Caps=0)

cluster = Cluster_2(viewer_4=pt_19, viewer_7=subset_3.List, viewer=subset.List, viewer_3=pt_20, viewer_8=subset_4.List)
cluster_2 = Cluster(brep_5=loft_2, brep_3=pipe_2, brep_4=pipe)  # disabled

# ==== cluster VersionCreate: 自动更新
D = ClusterInput()  # type
bang = ExplodeTree(Data=graft(D))  # -> Branch0, Branch1
T = Text(bang.Branch0)
entwine = Entwine(Branch00=bang.Branch1, Branch01=".", FlattenInputs=True)  # -> flatten(Result)
tmatch = MatchText(Text=T, Pattern=" ", Case=True)
join = TextJoin(Text=entwine)
P = ClusterInput()
p_n_c = PickNChoose(Pattern=tmatch, Stream0=T, Stream1=join)
D_2 = ClusterInput()
V = ClusterInput()
P_2 = Text(P)
V_2 = Integer(V)
D_3 = Integer(D_2)
entwine_2 = Entwine(Branch00=P_2, Branch02="Ver-", Branch03=p_n_c, Branch04=V_2, Branch05=".", Branch06=D_3, FlattenInputs=True)  # -> flatten(Result)
join_2 = TextJoin(Text=entwine_2)
R = ClusterOutput(join_2)

# ==== cluster Cluster
brep = ClusterInput()
brep_2 = Brep(brep)
material = CreateMaterial(
    Diffuse=ColourSwatch(SwatchColor=RGB(255, 254, 254)),
    Specular=RGB(255, 254, 254),
    Emission=RGB(0, 0, 0),
    Transparency=0,
    Shine=0)
brep_3 = ClusterInput()
brep_4 = ClusterInput()
brep_5 = ClusterInput()
brep_6 = Brep(brep_2)
brep_7 = Brep(brep_3)
brep_8 = Brep(brep_4)
brep_9 = Brep(brep_5)
geo = Geometry([brep_7, brep_6, brep_8, brep_9])
preview = CustomPreview(Geometry=geo, Material=material)  # disabled

# ==== cluster Cluster_2
viewer = ClusterInput()
viewer_2 = ParamViewer(viewer)
viewer_3 = ClusterInput()
viewer_4 = ClusterInput()
viewer_5 = ParamViewer(viewer_3)
viewer_6 = ParamViewer(viewer_4)
viewer_7 = ClusterInput()
viewer_8 = ClusterInput()
viewer_9 = ParamViewer(viewer_7)
viewer_10 = ParamViewer(viewer_8)
